# Grasshopper definition generateDocumentation.gh (Grasshopper 1.0.8)
# plug-ins: RhinoCodePluginGH

py3 = Python3Script()  # -> out, a
# ---------- py3: Python ----------
import os
import Grasshopper

# Get the Grasshopper document
gh_doc = ghenv.Component.OnPingDocument()

# Get the file path of the current Grasshopper file
gh_file_path = gh_doc.FilePath

# Extract the directory
if gh_file_path:
    gh_directory = os.path.dirname(gh_file_path)
else:
    gh_directory = "Grasshopper file not saved yet."

# Output
a = gh_directory
# ---------- end py3 ----------
panel = Panel("https://github.com/Eddy3D-Dev/Eddy3D/tree/dev")  # disabled
concat = Concatenate(FragmentA=py3.a, FragmentC="\", FragmentB="copilot-cli-mainline\docs\content\documentation")
python_3_script = Python3Script(workingDir=concat, pluginGHRepo=panel, pluginName="UMCF", export=Toggle(True))  # -> out, a; inputs workingDir: String, pluginGHRepo: String, pluginName: String
# ---------- python_3_script: Python ----------
import Grasshopper
import System.Drawing
import shutil
import os
import re
import json


def captureGrasshopperScreen(fileName, workingDirectory):
    print(f"Capturing screenshot for {fileName}...")
    # This script captures image from top left of Grasshopper canvas
    # Output image resolution is always 1000 px * 1000 px
    imageSettings = Grasshopper.GUI.Canvas.GH_Canvas.GH_ImageSettings()
    imageSettings.Zoom = 2.15
    canvas = Grasshopper.GH_InstanceServer.ActiveCanvas

    rect = System.Drawing.Rectangle(0, 0, 2, 2)  # Define the capture area

    # Capture the image
    imgsOfCanvas = canvas.GenerateHiResImage(rect, imageSettings)

    # Save the image to the working directory
    screenCapture = imgsOfCanvas[0][0]
    filePath = os.path.join(workingDirectory, "images", "components", fileName)

    shutil.copyfile(screenCapture, filePath)

    # Clean up the temporary file
    path = os.path.split(screenCapture)[0]
    shutil.rmtree(path)


def exportIcon(component, pluginName, workingDirectory):
    print(f"Exporting icon for {pluginName}...")
    fileName = getComponentName(component) + ".png"
    filePath = os.path.join(workingDirectory, "images", "icons", fileName)
    icon = component.Icon_24x24
    icon.Save(filePath)


def getComponentByName(document, name):
    print(f"Searching for component: {name}...")
    for component in document.Objects:
        if component.Name == name:
            return component


def exportDescription(component, pluginName, githubFolder, githubRepo=None, category=None):
    print(f"\n=== DEBUG: Starting export for {pluginName} ===")
    print(f"DEBUG: Working directory: {githubFolder}")
    
    originalName = component.Name
    bName = originalName.replace(pluginName + "_", "")
    name = getComponentName(component)
    description = component.Description

    # Create the components directory if it doesn't exist
    components_dir = os.path.join(githubFolder, "text", "components")
    os.makedirs(components_dir, exist_ok=True)
    
    print(f"DEBUG: Components directory: {components_dir}")

    lines = []
    header = f"## ![](../../images/icons/{name}.png) {bName}"
    
    if githubRepo:
        source = f" - [[source code]]({githubRepo}/{originalName.replace(' ', '%20')}.cs)\n"
        lines.append(header + source)
    else:
        lines.append(header + "\n")

    image = f"![](../../images/components/{name}.png)"
    lines.append(image)

    desc = description.split("Provided by ")[0].replace("\n", " ")
    lines.append("\n" + desc)

    try:
        lines.append("\n#### Input")
        for i in range(component.Params.Input.Count):
            iname = component.Params.Input[i].NickName
            alph = "".join(re.findall("[a-zA-Z]+", iname))
            if len(alph) == 0:
                continue

            cleaned_description = component.Params.Input[i].Description.replace("\n", " ")
            line = f"* ##### {iname} \n{cleaned_description}"
            lines.append(line)

        lines.append("\n#### Output")
        for i in range(component.Params.Output.Count):
            iname = component.Params.Output[i].NickName
            alph = "".join(re.findall("[a-zA-Z]+", iname))
            if len(alph) == 0:
                continue

            cleaned_description = component.Params.Output[i].Description.replace("\n", " ")
            line = f"* ##### {iname}\n{cleaned_description}"
            lines.append(line)
            
    except Exception as e:
        print(f"DEBUG: Error processing parameters: {str(e)}")

    fileName = f"{name}.md"
    filePath = os.path.join(components_dir, fileName)
    print(f"DEBUG: Writing to file: {filePath}")
    
    # Ensure the directory exists
    os.makedirs(os.path.dirname(filePath), exist_ok=True)
    
    with open(filePath, "w") as outf:
        outf.write("\n".join(lines))

    if category:
        categories_dir = os.path.join(githubFolder, "text", "categories")
        os.makedirs(categories_dir, exist_ok=True)
        categoryFile = os.path.join(categories_dir, f"{category}.md")
        print(f"DEBUG: Updating category file: {categoryFile}")
        
        # Create display name by replacing underscores with spaces
        display_name = name.replace('_', ' ')
        
        # Write to category file with proper casing and formatting
        with open(categoryFile, "a") as catFile:
            catFile.write(f"* [{display_name}](components/{name}.md)\n")
    
    print("=== DEBUG: Export completed ===\n")


def getPluginComponents(pluginName):
    components = {}
    doc = Grasshopper.Instances.ActiveCanvas.Document

    for proxy in Grasshopper.Instances.ComponentServer.ObjectProxies:
        if proxy.Obsolete:
            continue
        category = proxy.Desc.Category
        if category.strip() == pluginName:
            if str(proxy.Kind) == "CompiledObject":
                components[proxy.Desc.Name] = proxy.CreateInstance()
            elif str(proxy.Kind) == "UserObject":
                components[proxy.Desc.Name] = Grasshopper.Kernel.GH_UserObject(
                    proxy.Location
                ).InstantiateObject()

    return components


def createFolderStructure(githubFolder):
    print(f"\n=== DEBUG: Creating folder structure ===")
    print(f"Base directory: {githubFolder}")

    # Create base directory if it doesn't exist
    os.makedirs(githubFolder, exist_ok=True)

    # Create githubFolder/images
    imagesFolder = os.path.join(githubFolder, "images")
    componentsImagesFolder = os.path.join(imagesFolder, "components")
    componentsIconsFolder = os.path.join(imagesFolder, "icons")
    
    print(f"Creating image folders:")
    print(f"- Images: {imagesFolder}")
    print(f"- Components: {componentsImagesFolder}")
    print(f"- Icons: {componentsIconsFolder}")
    
    folders = [imagesFolder, componentsImagesFolder, componentsIconsFolder]
    for folder in folders:
        os.makedirs(folder, exist_ok=True)

    # Create githubFolder/text
    textFolder = os.path.join(githubFolder, "text")
    categoriesFolder = os.path.join(textFolder, "categories")
    componentsFolder = os.path.join(textFolder, "components")
    
    print(f"\nCreating text folders:")
    print(f"- Text: {textFolder}")
    print(f"- Categories: {categoriesFolder}")
    print(f"- Components: {componentsFolder}")
    
    folders = [textFolder, categoriesFolder, componentsFolder]
    for folder in folders:
        os.makedirs(folder, exist_ok=True)
        
    print("=== Folder structure creation completed ===\n")


def getComponentName(component):
    # Remove illegal strings
    return (
        component.Name.replace(pluginName + "_", "")
        .replace(" ", "_")
        .replace("/", "_")
        .replace("?", "_")
        .replace("|", "_")
    )

def generateMainReadme(githubFolder, pluginName, pluginComponents=None):
    """
    Generate the main README.md file for the plugin with comprehensive details.
    
    Args:
        githubFolder (str): Base directory for the documentation.
        pluginName (str): Name of the plugin.
        pluginComponents (dict, optional): Dictionary containing component information.
    """
    readme_path = os.path.join(githubFolder, "index.md") #Changed from README to index, according to repo structure
    
    with open(readme_path, "w") as readme:
        # Header Section
        readme.write(f"# {pluginName}\n\n")
        readme.write("![UMCF](./images/umcf.gif)\n\n")
        readme.write("### A Grasshopper plugin for microclimate simulations\n\n")
        readme.write("[![Language](https://img.shields.io/badge/language-C%23-gray)](https://github.com/your-repo/umcf)\n")
        readme.write("[![Status](https://img.shields.io/badge/status-beta-brightgreen)](https://github.com/your-repo/umcf)\n\n")
        
        # Overview Section
        readme.write("## Overview\n\n")
        readme.write("**UMCF** (`urbanMicroclimateFoam`) is an open-source solver for coupled physical processes modeling urban microclimate based on `OpenFOAM`.\n\n")
        readme.write("### Key Features\n\n")
        readme.write(" **CFD** - Computational fluid dynamics model\n")
        readme.write("- Solves turbulent, convective airflow\n")
        readme.write("- Handles heat and moisture transport in the `air` subdomain\n\n")
        readme.write(" **HAM** - Heat moisture transport model\n")
        readme.write("- Manages absorption and transport\n")
        readme.write("- Controls storage of heat and moisture in porous building materials\n\n")
        readme.write(" **RAD** - Radiation model\n")
        readme.write("- Calculates net longwave and shortwave radiative heat fluxes\n")
        readme.write("- Uses view factor approach\n\n")
        readme.write(" **VEG** - Vegetation model\n")
        readme.write("- Solves heat balance for urban trees\n")
        readme.write("- Handles green surfaces\n\n")
        
        # Installation Section
        readme.write("## Installation\n\n")
        readme.write("### Prerequisites\n")
        readme.write("- `bluecfd core 2020`\n")
        readme.write("- `UMCF` plugin from `PackageManager`\n")
        readme.write("- `CheckInstallation` component\n\n")
        readme.write("### Step-by-Step Guide\n\n")
        readme.write("1. **Install blueCFD-Core**\n")
        readme.write("   - Download `blueCFD-Core-2020-1-win64-setup.exe` from [bluecfd.github.io](https://bluecfd.github.io/Core/Downloads/#bluecfd-core-2020-1)\n")
        readme.write("   - This provides `OpenFOAM 8`\n\n")
        readme.write("2. **Install UMCF Plugin**\n")
        readme.write("   - In `Rhinoceros`, execute `PackageManager` command\n")
        readme.write("   - Search for `UMCF` and click Install ([View on RhinoPackages](https://www.rhinopackages.com/?search=umcf))\n")
        readme.write("   - Optional: Check `Include pre-releases` for all versions\n")
        readme.write("   - Restart `Rhinoceros` to complete installation\n\n")
        readme.write("   ![PackageManager](images/PackageManager.png)\n\n")
        readme.write("3. **Verify Installation**\n")
        readme.write("   - Navigate to `UMCF` tab in `Grasshopper` ribbon\n")
        readme.write("   - Find `Check Installation` under `Meta` subcategory\n")
        readme.write("   - Set `Check` input to `True`\n")
        readme.write("   - This verifies integrity of `blueCDF-Core 2020` and `urbanMicroclimateFoam` files\n\n")
        readme.write("   ![InstallationCheck](images/InstallationCheck.png)\n\n")
        
        # Features and workflow section
        readme.write("## Features & Workflow\n\n")
        workflow_steps = [
            ("1. Simulation Domain Configuration", "The simulation domain consists of three regions:\n   1. `air` region\n   2. `solid` region\n   3. `vegetation` region"),
            ("2. Air Region Setup", "Managed by `UMCF.AirRegion` class\n- Determined by `Box Domain Dimensions`\n- Includes `Atmospheric Boundary Layer` (`ABL`) condition:\n  - `Wind Speed`\n  - `Height`\n  - `Wind Direction`\n\n![Air Region Configuration](images/1.png)"),
            ("3. Solid Region Setup", "Managed by `UMCF.SolidRegion` class\n- Requires `mesh` geometry input\n- Stores:\n - `region name`\n - `material`\n - Optional `thickness` value\n - `mesh parameters`\n - `building temperature`\n\n![Solid Region Setup](images/2.png)"),
            ("4. Vegetation Region Configuration", "Managed by `UMCF.VegetationRegion\n- Requirements:\n - `mesh` geometry input\n - `Leaf Area Density` (`LAD`)\n - `vegetation properties`\n - `mesh parameters\n\n![Vegetation Region Configuration](images/3.png)"),
            ("5. Timing Parameters","Uses `EnergyPlus Weather` file (`.EPW`)\n- Requires:\n - `start day` (365-day based)\n - `start time\n - `duration\n - `end time` is calculated by adding the `start time` and `duration`\n\n![Timing Configuration](images/4.png)"),
            ("6. Simulation Settings", "Key parameters include:\n - `Number of CPUs` (`N`)\n - `maxFluidIterations` (`F`)\n - `Write Interval` (`W`)\n - `Initial Solid Timestep Factor` (`I`)\n - `minDeltaT` (`T`)\n - `maxDeltaT` (`T`)\n - `minFluidIteration` (`F`)\n - `pcEqnForm` (`p`)\n - `dampingThickness` (`d`)\n - `alphaCoefU` (`U`)\n - `alphaCoefT` (`T`)\n\n![Simulation Settings](images/5.png)"),
            ("7. Case Generation", "- Connect all configured components\n- Set `Write Case` to `True`\n- Outputs `UMCF.UMCFCase` which must be connected to the `Case Run` component\n\n![Case Generation](images/6.png)"),
            ("8. Simulation Execution", "- Two-step process:\n - 1. Prepare simulation: Set `Prepare Simulation` or `Prepare Simulation in Parallel` to `True`\n - 2. Run Simulation: Set `Run Simulation` or `Run Simulation in Parallel` to `True`\n\n Note: Use consistent parallel settings for preparation and execution\n\n![Simulation Execution](images/7.png)"),
            ("9. Analysis & Visualization", "- Uses `probing` component\n- Samples field values at point locations\n- Writes results to file using input fields\n- Enables value analysis and visualization by running the `probes` function\n\n![Analysis & Visualization](images/8.png)"),
        ]
        for step, description in workflow_steps:
            readme.write(f"### {step}\n")
            readme.write(f"{description}\n\n")
        
        # Documentation Section
        readme.write("## Documentation\n\n")
        readme.write("[UMCF Component list](text/README.md)\n\n")
        
        # Presentation Section
        readme.write("## Presentation\n\n")
        readme.write('<a href="https://www.youtube.com/watch?v=PuFVGLvi_Xo" target="_blank" rel="noopener noreferrer">\n')
        readme.write('    <img src="https://img.youtube.com/vi/PuFVGLvi_Xo/maxresdefault.jpg" width="480" alt="Final Presentation --- 24Fa --- Microclimate-LSTM-Kriging" class="off-glb">\n')
        readme.write('</a>\n\n')
        
        # Team Section
        readme.write("## Team\n\n")
        team_table = [
            ("Marcelo Alvarez", "Masters", "Architecture (DC)", "ARCH", "[@alvarezdmarch](https://github.com/alvarezdmarch)"),
            ("Gonzalo Vegas", "PhD", "Architecture", "ARCH", "[@gvegaso](https://github.com/gvegasol)"),
            ("Shruti Jadhav", "Masters", "Architecture (HBP)", "ARCH", "[@ShrutiJadhav27](https://github.com/ShrutiJadhav27)"),
            ("Rui Shen", "Masters", "Architecture (DC)", "ARCH", "[@ShiRo-25](https://github.com/ShiRo-25)"),
            ("Chinmay Rothe", "Masters", "Architecture (HBP)", "ARCH", "[@ChinmayR5](https://github.com/ChinmayR5)"),
        ]
        readme.write("| Name | Seniority | Major | Department | GitHub |\n")
        readme.write("|------|-----------|-------|------------|---------|\n")
        for name, seniority, major, department, github in team_table:
            readme.write(f"| {name} | {seniority} | {major} | {department} | {github} |\n")

componentsHeights = {}

if export:
    if not workingDir:
        # This is set to my default folder
        githubFolder = "C:/Users/Administrator/Documents/GitHub/%s-primer/" % pluginName
    else:
        githubFolder = workingDir

    # Create the folder structure
    createFolderStructure(githubFolder)

    doc = Grasshopper.Instances.ActiveCanvas.Document

    # Find all Components/UserObjects under plugin name
    components = getPluginComponents(pluginName)

    # Capture image for each component
    for GHObjectName, GHObject in components.items():

        # Add object to document
        if GHObject.Attributes:
            GHObject.Attributes.Pivot = System.Drawing.PointF(200, 215)
            doc.AddObject(GHObject, False, 0)

            # Find the component by name
            component = getComponentByName(doc, GHObjectName)

            # Capture Grasshopper screen
            captureGrasshopperScreen(getComponentName(component) + ".png", githubFolder)

            # Export icon
            exportIcon(component, pluginName, githubFolder)

            # Export description
            exportDescription(component, pluginName, githubFolder, pluginGHRepo)

            # Save Height
            componentsHeights[getComponentName(component)] = str(
                component.Attributes.Bounds.Height
            )

            # Remove the object
            doc.RemoveObject(GHObject, False)

    # Write height data as a json file
    with open(
        githubFolder + "/images/componentsHeight.json", "w", encoding="utf-8"
    ) as compHeight:
        json.dump(componentsHeights, compHeight, ensure_ascii=False, indent=4)
    

    # Generate the summary and category text files
pluginComponents = {}
generateMainReadme(workingDir, pluginName, pluginComponents)



# Iterate through all components to organize them by category and exposure level
for proxy in Grasshopper.Instances.ComponentServer.ObjectProxies:
    if proxy.Obsolete:
        continue
    nickName = proxy.Desc.NickName
    category = proxy.Desc.Category

    if category.strip() == pluginName:
        subCategory = proxy.Desc.SubCategory
        subCategories = pluginComponents.keys()
        if subCategory not in subCategories:
            pluginComponents[subCategory] = {}

        # Get the exposure level from the component proxy
        expo = (
            str(proxy.Exposure).split(",")[-1].strip()
        )  # Get the exposure level (e.g., Public, Private)
        expos = pluginComponents[subCategory].keys()
        if expo not in expos:
            pluginComponents[subCategory][expo] = []

        # Add the component name to the appropriate exposure level in the category
        name = getComponentName(proxy.Desc)
        pluginComponents[subCategory][expo].append(name)

os.makedirs(os.path.join(workingDir, "text", "categories"), exist_ok=True)
os.makedirs(os.path.join(workingDir, "text", "components"), exist_ok=True)

# For the category files section:
for subCategory in pluginComponents:
    categoryFilePath = os.path.join(workingDir, "text", "categories", f"{subCategory}.md")
    with open(categoryFilePath, "w") as categoryFile:
        categoryFile.write(f"# {subCategory}\n")
        for expo in sorted(pluginComponents[subCategory].keys()):
            categoryFile.write(f"#### Exposure: {expo}\n")
            for comp in pluginComponents[subCategory][expo]:
                display_name = comp.replace('_', ' ')
                categoryFile.write(f"* [{display_name}](components/{comp}.md)\n")

# Ensure the summary directory exists
os.makedirs(os.path.join(workingDir, "text"), exist_ok=True)

# For the summary file section:
with open(os.path.join(workingDir, "text", "README.md"), "w") as summaryFile:
    summaryFile.write("# UMCF Component list\n")
    for category in sorted(pluginComponents.keys()):
        summaryFile.write(f"## {category}\n")
        for expo in sorted(pluginComponents[category].keys()):
            summaryFile.write(f"### Exposure: {expo}\n")
            for comp in pluginComponents[category][expo]:
                display_name = comp.replace('_', ' ')
                summaryFile.write(f"* [{display_name}](components/{comp}.md)\n")
# ---------- end python_3_script ----------
panel_2 = Panel(python_3_script.out)
